# Grasshopper definition GBS Tool.gh (Grasshopper 1.0.7)
# plug-ins: TT Toolbox, LunchBox, Grasshopper-Tekla Link 2022.1.11, MetaHopper, Human UI, Human

# ---- group: Arial Font Types
choose_font = Slider(15, range=15..19)
fonts = FontTable()
item = ListItem(List=fonts, Index=choose_font, Wrap=True)
font_type = Panel(item)

# ----
selobj = GetSelectedObjects(AllObjects_Object=[kiosk_lenght_lk_m, kiosk_width_bk_m, kiosk_height_hk_m, base_length_larger_than_kiosk, base_thickness_tb_m, total_weight_of_kiosk_with_all_equipment, force_coefficient_1_5_for_prisms_1_for_c, design_peak_velocity_pressure])  # -> ComponentObjects, ParamObjects, OtherObjects
slider = CreateSlider(Slider=selobj.ParamObjects, ShowBounds=False, ShowTicks=False, ShowTooltip=False, ShowValLabel=True, showLabel=True)
values = ValueListener(Elements=slider, SomeProperty=True)  # -> Values, Indices
setobj = SetObjectValue(ObjectToSet=graft(selobj.ParamObjects), ValueToSet=values.Values)

selobj_2 = GetSelectedObjects(AllObjects_Object=[inclination_of_the_foundation_base_to_th, embedment_depth_d_m, water_table_depth_below_ground_level_dw, characteristic_angle_of_shearing_resista, characteristic_cohesion_in_terms_of_effe, characteristic_undrained_shear_strength, saturated_soil_density_conservatively_ba, moist_bulk_soil_density_ymoist_kn_m3, characteristic_compressive_cylinder_stre, nominal_cover_it_is_equal_to_the_minimum])  # -> ComponentObjects, ParamObjects, OtherObjects
slider_2 = CreateSlider(Slider=selobj_2.ParamObjects, ShowBounds=False, ShowTicks=False, ShowTooltip=False, ShowValLabel=True, showLabel=True)
values_2 = ValueListener(Elements=slider_2, SomeProperty=True)  # -> Values, Indices
setobj_2 = SetObjectValue(ObjectToSet=graft(selobj_2.ParamObjects), ValueToSet=values_2.Values)

# ---- group: Window Size
panel_height = Slider(0.7, range=0..1)
panel_width = Slider(4, range=0..10)
getscreen = GetScreenDimensions()  # -> Width, Height
multiplication = Multiplication(A=getscreen.Height, B=panel_height)
division = Division(A=getscreen.Width, B=panel_width)

# ----
selobj_3 = GetSelectedObjects(AllObjects_Object=fos_minimum_required_ratio_of_the_bearin)  # -> ComponentObjects, ParamObjects, OtherObjects
slider_3 = CreateSlider(Slider=selobj_3.ParamObjects, ShowBounds=False, ShowTicks=False, ShowTooltip=False, ShowValLabel=True, showLabel=True)
values_3 = ValueListener(Elements=slider_3, SomeProperty=True)  # -> Values, Indices
setobj_3 = SetObjectValue(ObjectToSet=graft(selobj_3.ParamObjects), ValueToSet=values_3.Values)

selobj_4 = GetSelectedObjects(AllObjects_Object=foundation_pad_width_for_a_rectangular_s)  # -> ComponentObjects, ParamObjects, OtherObjects
slider_4 = CreateSlider(Slider=selobj_4.ParamObjects, ShowBounds=False, ShowTicks=False, ShowTooltip=False, ShowValLabel=True, showLabel=True)
values_4 = ValueListener(Elements=slider_4, SomeProperty=True)  # -> Values, Indices
setobj_4 = SetObjectValue(ObjectToSet=graft(selobj_4.ParamObjects), ValueToSet=values_4.Values)

# ---- group: Costain Branding / Copyright Info
label = CreateLabel(LabelText="Costain Group Ltd.", LabelSize=8, Justification=0)
horizontal_alignment = ValueList({"Left": 0, "Center": 1, "Right": 2}, selected="Center")
vertical_alignment = ValueList({"Top": 2, "Middle": 1, "Bottom": 0}, selected="Middle")
adjustpos = AdjustElementPositioning(
    ElementsToAdjust=label,
    Margin=Slider(0, range=0..100),
    AbsolutePositioning=True,
    HorizontalAlignment=horizontal_alignment,
    VerticalAlignment=vertical_alignment)

# ---- group: Contact Info
dummy_text = Panel("Discipline Lead: David Owens")
label_2 = CreateLabel(LabelText=dummy_text, LabelSize=12, Justification=0)

dummy_text_2 = Panel("david.owens@costain.com")
label_3 = CreateLabel(LabelText=dummy_text_2, LabelSize=12, Justification=0)

dummy_text_3 = Panel("david.potter1@costain.com")
label_4 = CreateLabel(LabelText=dummy_text_3, LabelSize=12, Justification=0)

dummy_text_4 = Panel("Product Owner: David Potter")
label_5 = CreateLabel(LabelText=dummy_text_4, LabelSize=12, Justification=0)

# ---- group: Export Calculation
button = CreateButton(ButtonName="Export Calculation", ButtonStyle=0)
values_5 = ValueListener(Elements=button, SomeProperty=True)  # -> Values, Indices
horizontal_alignment_2 = ValueList({"Left": 0, "Center": 1, "Right": 2}, selected="Center")
expander = CreateExpander(UIElements=button, Header="Export Calculation", Open=True)
adjustpos_2 = AdjustElementPositioning(
    ElementsToAdjust=button,
    Margin=Slider(10, range=0..100),
    AbsolutePositioning=False,
    HorizontalAlignment=horizontal_alignment_2)

# ---- group: Export Drawing
button_2 = CreateButton(ButtonName="Export Drawing", ButtonStyle=0)
values_6 = ValueListener(Elements=button_2, SomeProperty=True)  # -> Values, Indices
python = GhPythonScript(x=values_6.Values)  # -> out, a
# ---------- python: Python ----------
__author__ = "bensay"
__version__ = "2021.02.10"

import rhinoscriptsyntax as rs

if x == "Yes":
    a = 1
elif x == "No":
    a = 0
# ---------- end python ----------
horizontal_alignment_3 = ValueList({"Left": 0, "Center": 1, "Right": 2}, selected="Center")
expander_2 = CreateExpander(UIElements=button_2, Header="Export Drawing", Open=True)
adjustpos_3 = AdjustElementPositioning(
    ElementsToAdjust=button_2,
    Margin=Slider(10, range=0..100),
    AbsolutePositioning=False,
    Width=Slider(213, range=0..1000),
    HorizontalAlignment=horizontal_alignment_3)

# ---- group: Info Text
dummy_text_5 = Panel("Automated Ground Bearing Slab")
label_6 = CreateLabel(LabelText=dummy_text_5, LabelSize=24, Justification=0)

dummy_text_6 = Panel("An automated design tool for Grounf Bearing Slabs.")
tb = CreateTextBlock(Text=dummy_text_6, TextSize=12, Justification=1)

# ---- group: Costain Dark Blue
costain_dark_blue = Panel("""100
86
39
46""")
item_2 = ListItem(List=flatten(costain_dark_blue), Index=0, Wrap=True)  # -> Item, Item1, Item2, Item3
cmyk = ColourCMYK(Cyan=item_2.Item, Magenta=item_2.Item1, Yellow=item_2.Item2, Key=item_2.Item3)

# ---- group: Costain Light Blue
costain_blue = Panel("""100
59
8
1""")
item_3 = ListItem(List=flatten(costain_blue), Index=0, Wrap=True)  # -> Item, Item1, Item2, Item3
cmyk_2 = ColourCMYK(Cyan=item_3.Item, Magenta=item_3.Item1, Yellow=item_3.Item2, Key=item_3.Item3)

# ---- group: Contact Info
merge = Merge(Data1=flatten(label_5), Data2=flatten(label_4))
merge_2 = Merge(Data1=flatten(label_2), Data2=flatten(label_3))
horizontal_alignment_4 = ValueList({"Left": 0, "Center": 1, "Right": 2}, selected="Center")
number_slider = Slider(20, range=0..100)
stack = CreateStack(UIElements=merge, Horizontal=invert(True))
stack_2 = CreateStack(UIElements=merge_2, Horizontal=invert(True))
adjustpos_4 = AdjustElementPositioning(ElementsToAdjust=stack, Margin=number_slider, AbsolutePositioning=False, HorizontalAlignment=horizontal_alignment_4)
adjustpos_5 = AdjustElementPositioning(ElementsToAdjust=stack_2, Margin=number_slider, AbsolutePositioning=False, HorizontalAlignment=horizontal_alignment_4)

# ---- group: Info Text
horizontal_alignment_5 = ValueList({"Left": 0, "Center": 1, "Right": 2}, selected="Center")
adjustelem = AdjustElementAppearance(ElementsToAdjust=label_6, FontSize=Slider(18, range=0..100))
adjustpos_6 = AdjustElementPositioning(
    ElementsToAdjust=label_6,
    Margin=Slider(30, range=0..100),
    AbsolutePositioning=False,
    HorizontalAlignment=horizontal_alignment_5)
adjustpos_7 = AdjustElementPositioning(
    ElementsToAdjust=tb,
    Margin=Slider(20, range=0..100),
    AbsolutePositioning=False,
    HorizontalAlignment=horizontal_alignment_5)
adjustelem_2 = AdjustElementAppearance(ElementsToAdjust=tb, Foreground=ColourSwatch(SwatchColor=RGB(255, 255, 255)))

# ----
file_path = FilePath("C:\Users\bensay\Costain Group Plc\Digital Engineering Solutions - AutoDesign\02-Workstreams\18-Ground Bearing Slab\Input Form\GBS_Input_form_TEST1.xlsx")

# ---- group: Excel input reader
number = Number(29)
number_2 = Number(8)
number_3 = Number(1)
subtraction = Subtraction(A=number, B=1)
read_excel_sheet = ReadExcelSheet(Run=Toggle(True), FilePath=file_path, Worksheet=number_3, Listen=False)  # -> UserMessages, Columns, Rows
construct_domain = ConstructDomain(DomainStart=number_2, DomainEnd=subtraction)
subtraction_2 = Subtraction(A=subtraction, B=number_2)
data = Data(read_excel_sheet.Columns)
range = Range(Domain=construct_domain, Steps=subtraction_2)
list_item = ListItem(List=data, Index=range, Wrap=True)  # -> simplify(Item)
list_length = ListLength(List=list_item)  # -> flatten(Length)
list_length_2 = ListLength(List=list_length)
number_4 = Number(5)
subtraction_3 = Subtraction(A=list_length_2, B=number_4)
# Spread Sheet Input
series = Series(Start=number_4, Step=1, Count=subtraction_3)  # -> graft(Series)
construct_path = ConstructPath(Indices=series)
tree_branch = TreeBranch(Tree=list_item, Path=construct_path, MaintainPaths=False)
text_join = TextJoin(Text=tree_branch, Join=",")  # -> flatten(Result)

# ----
panel = Panel(file_path)

# ---- group: Reinforcement
coefficient_taking_account_of_long_term = ValueList({"Compession in flexure and axial load": 0.85, "Other phenomena": 1.00}, selected="Compession in flexure and axial load")  # "Coefficient taking account of long-term effects and unfavourable effects resulting from the way the load is applied, on the compressive strenght (see table NA.1, relating to Cl. 3.1.6): acc"
foundation_pad_width_for_a_rectangular_s = Slider(0.344, range=0..1)  # "Foundation pad width, for a rectangular section this is 1.0m: b (m)"
partial_factor_of_safety_for_concrete_se = ValueList({"1.5"}, selected="1.5")  # "Partial factor of safety for concrete (see 2.4.2.4 and table NA.1): yc"
possible_bar_size = ValueList({"2.5", "5", "6", "7", "8", "9", "10", "12", "16", "20", "25", "32", "40", "50"}, selected=["6", "7", "10", "16", "20", "25"])
bar_or_mesh = ValueList({"Bar": 0, "Mesh": 1}, selected="Mesh")
possible_mesh_size = ValueList({"A393", "A252", "A193", "A142", "B1131", "B785", "B503", "B365", "B283", "B196", "C785", "C636", "C503", "C385", "C283", "D49"}, selected=["A193", "A142", "B1131"])

nominal_cover_it_is_equal_to_the_minimum = Slider(214, range=0..500)  # "Nominal cover (it is equal to the minimum cover + deviation, to be calculated on 4.4.1.3 of EC in conjunction with the NA (DeltaCdev=10mm) and Table 1 of the Guide to BS EN 206-1 (BS8500): cnom (mm)"
characteristic_compressive_cylinder_stre = Slider(28, range=0..50)  # "Characteristic Compressive cylinder strength of concrete at 28 Days: fck (Mpa)"
characteristic_yield_strenght_of_reinfor = ValueList({"500"}, selected="500")  # "Characteristic yield strenght of reinforment: fyk (MPa)"

# ---- group: Soil
fos_minimum_required_ratio_of_the_bearin = Slider(3, range=0..10)  # "FOS: Minimum required ratio of the bearing capacity of the ground at its initial undrained shear strength to the applied SLS load to ensure settlement calculations are not required (EC7, CL. 6.6.2 (16))"
# Preferences
partial_factor_for_soil_angle_of_shearin = ValueList({"SLS": 1.00, "ULS": 1.25}, selected="SLS")  # "Partial factor for soil angle of shearing resistance: yfP"
partial_factor_for_cohesion_ycp = ValueList({"SLS": 1.00, "ULS": 1.25}, selected="SLS")
partial_factor_for_undrained_shear_stren = ValueList({"SLS": 1.00, "ULS": 1.40}, selected="SLS")  # "Partial factor for undrained shear strength: ycu"
partial_factor_for_bearing_resistance_yr = ValueList({"SLS": 1.00, "ULS": 1.40}, selected="SLS")

# ---- group: Soil Parameters for bearing capacity
saturated_soil_density_conservatively_ba = Slider(51.9, range=0..100)  # "Saturated soil density, conservatively based on an assumed void ratio of 0.235: ysat (kN/m3)"
characteristic_angle_of_shearing_resista = Slider(23, range=0..90)  # "Characteristic angle of shearing resistance, in terms of effective stress: fP (deg)"
characteristic_cohesion_in_terms_of_effe = Slider(52, range=0..100)  # "Characteristic cohesion, in terms of effective stress: cP (kN/m2)"
inclination_of_the_foundation_base_to_th = Slider(29.7, range=0..90)  # "Inclination of the foundation base to the horizontal: a (Deg)"
characteristic_undrained_shear_strength = Slider(576, range=0..2000)  # "Characteristic undrained shear strength: cu (kN/m2)"
water_table_depth_below_ground_level_dw = Slider(7.38, range=0..10)  # "Water table depth, below ground level: Dw (m)"
moist_bulk_soil_density_ymoist_kn_m3 = Slider(45, range=0..100)
embedment_depth_d_m = Slider(4.809, range=0..10)

# ----
total_weight_of_kiosk_with_all_equipment = Slider(24, range=0..100)  # "Total weight of KIOSK with all equipment (kN)"
# Secondary Inputs
force_coefficient_1_5_for_prisms_1_for_c = Slider(1.3, range=0..3)  # "Force Coefficient, 1.5 for Prisms, 1 for Cylinders: cf"
base_length_larger_than_kiosk = Slider(4.32, range=0..10)
design_peak_velocity_pressure = Slider(1.92, range=0..5)
base_width_larger_than_kiosk = Slider(2.25, range=0..10)
kiosk_height_hk_m = Slider(5, range=0..20)
base_thickness_tb_m = Slider(2, range=0.2..2)
# Primary Inputs
kiosk_lenght_lk_m = Slider(2.71, range=0..10)
kiosk_width_bk_m = Slider(3.35, range=0..10)

# ---- group: Location
rotation = Slider(0, range=0..180)
tekla_point = TeklaPoint(null, TeklaPoints="28800;24000;0")

# ----
name = Panel("Slab 1")

# ----
# DESIGN Optimisation
# Input
galapagos = Galapagos(fitness=number_8, gene=[base_thickness_tb_m, base_length_larger_than_kiosk])

# ----
# Data Set Up
value_list = ValueList({"GH Interface": 1, "Excel Read": 0}, selected="GH Interface")
merge_3 = Merge(
    Data1=name,
    Data2=kiosk_lenght_lk_m,
    Data3=kiosk_width_bk_m,
    Data4=kiosk_height_hk_m,
    Data5=total_weight_of_kiosk_with_all_equipment,
    Data6=base_length_larger_than_kiosk,
    Data7=base_length_larger_than_kiosk,
    Data8=base_thickness_tb_m,
    Data9=design_peak_velocity_pressure,
    Data10=force_coefficient_1_5_for_prisms_1_for_c,
    Data11=characteristic_angle_of_shearing_resista,
    Data12=characteristic_cohesion_in_terms_of_effe,
    Data13=characteristic_undrained_shear_strength,
    Data14=saturated_soil_density_conservatively_ba,
    Data15=moist_bulk_soil_density_ymoist_kn_m3,
    Data16=inclination_of_the_foundation_base_to_th,
    Data17=embedment_depth_d_m,
    Data18=water_table_depth_below_ground_level_dw,
    Data19=nominal_cover_it_is_equal_to_the_minimum,
    Data20=characteristic_compressive_cylinder_stre,
    Data21=characteristic_yield_strenght_of_reinfor)
text_join_2 = TextJoin(Text=merge_3, Join=",")
stream_filter = StreamFilter(Gate=value_list, Stream0=text_join, Stream1=text_join_2)
list_length_3 = ListLength(List=stream_filter)
evaluate = Evaluate(Expression="if(l=1,1,0)", l=list_length_3)
stream_gate = StreamGate(Stream=stream_filter, Gate=evaluate)  # -> Target0, Target1
text_split = TextSplit(Text=stream_gate.Target0, Separators=",")  # -> simplify(Result)
text_split_2 = TextSplit(Text=stream_gate.Target1, Separators=",")  # -> flatten(Result)
flip_matrix = FlipMatrix(Data=text_split)
panel_2 = Panel(flip_matrix)
flip_matrix_2 = FlipMatrix(Data=text_split_2)
explode_tree = ExplodeTree(Data=flip_matrix)  # -> simplify(graft(Branch0)), simplify(graft(Branch1)), simplify(graft(Branch2)), simplify(graft(Branch3)), simplify(graft(Branch4)), simplify(graft(Branch5)), simplify(graft(Branch6)), simplify(graft(Branch7))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
explode_tree_2 = ExplodeTree(Data=flip_matrix_2)  # -> flatten(Branch0), flatten(Branch1), flatten(Branch2), flatten(Branch3), flatten(Branch4), flatten(Branch5), flatten(Branch6), flatten(Branch7)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
kiosk_lenght_m = Relay([explode_tree.Branch1, explode_tree_2.Branch1])
base_lenght_m = Relay([explode_tree.Branch5, explode_tree_2.Branch5])
foundation_name = Relay([explode_tree.Branch0, explode_tree_2.Branch0])
kiosk_width_m = Relay([explode_tree.Branch2, explode_tree_2.Branch2])
base_thickness_m = Relay([explode_tree.Branch7, explode_tree_2.Branch7])
kiosk_height_m = Relay([explode_tree.Branch3, explode_tree_2.Branch3])
total_weight_of_kiosk_with_all_equipment_2 = Relay([explode_tree_2.Branch4, explode_tree.Branch4])
base_width_m = Relay([explode_tree.Branch6, explode_tree_2.Branch6])
force_coefficient = Relay([explode_tree_2.Branch9, explode_tree.Branch9])
design_peak_velocity_pressure_2 = Relay([explode_tree.Branch8, explode_tree_2.Branch8])
characteristic_angle_of_shearing_resista_2 = Relay([explode_tree_2.Branch10, explode_tree.Branch10])  # "Characteristic angle of shearing resistance, in terms of effective stress"
characteristic_cohesion_in_terms_of_effe_2 = Relay([explode_tree_2.Branch11, explode_tree.Branch11])  # "Characteristic cohesion, in terms of effective stress"
characteristic_undrained_shear_strength_2 = Relay([explode_tree_2.Branch12, explode_tree.Branch12])
water_table_depth_below_ground_level = Relay([explode_tree_2.Branch17, explode_tree.Branch17])
saturated_soil_density_conservatively_ba_2 = Relay([explode_tree_2.Branch13, explode_tree.Branch13])  # "Saturated soil density, conservatively based on an assumed void ratio of 0.235"
moist_bulk_soil_density = Relay([explode_tree_2.Branch14, explode_tree.Branch14])
characteristic_yield_strength_of_reinfor = Relay([explode_tree_2.Branch20, explode_tree.Branch20])  # "Characteristic yield strength of reinforcement"
inclination_of_the_foundation_base_to_th_2 = Relay([explode_tree_2.Branch15, explode_tree.Branch15])  # "Inclination of the foundation base to the horizontal"
embedment_depth = Relay([explode_tree_2.Branch16, explode_tree.Branch16])
nominal_cover = Relay([explode_tree_2.Branch18, explode_tree.Branch18])
characteristic_compressive_cylinder_stre_2 = Relay([explode_tree_2.Branch19, explode_tree.Branch19])  # "Characteristic Compressive cylinder strength of concrete at 28 Days"
# Modeling
division_2 = Division(A=nominal_cover, _1000=1000)
addition = Addition(A=base_width_m, B=kiosk_width_m)
# Model + Calculation
# Calculation
addition_2 = Addition(A=base_lenght_m, B=kiosk_lenght_m)
expression = Expression(Lb=addition_2, Bb=addition, tb=base_thickness_m, Expression="Lb*Bb*tb")

# ---- group: Bearing Capacity
expression_2 = Expression(
    fP=characteristic_angle_of_shearing_resista_2,
    yfP=partial_factor_for_soil_angle_of_shearin,
    Expression="Atan(Tan(fP*π/180)/yfP)*180/π")
expression_3 = Expression(ysat=saturated_soil_density_conservatively_ba_2, Expression="ysat-10")
expression_4 = Expression(
    ymoist=moist_bulk_soil_density,
    Dw=water_table_depth_below_ground_level,
    ysat=saturated_soil_density_conservatively_ba_2,
    D=embedment_depth,
    Expression="ymoist*Dw+ysat*(D-Dw)")
expression_5 = Expression(
    ymoist=moist_bulk_soil_density,
    Dw=water_table_depth_below_ground_level,
    ysubm=expression_3,
    D=embedment_depth,
    Expression="ymoist*Dw+ysubm*(D-Dw)")

# ----
text = Text(["A393,200,200,10,10,393,393,6.16,14,70.96", "A252,200,200,8,8,252,252,3.95,22,45.5", "A193,200,200,7,7,193,193,3.02,28.7,34.79", "A142,200,200,6,6,142,142,2.22,39.1,25.57", "B1131,100,200,12,8,1131,252,10.9,8,125.57", "B785,100,200,10,8,785,252,8.14,10.7,93.57", "B503,100,200,8,8,503,252,5.93,14.6,68.31", "B385,100,200,7,7,385,193,4.53,19.2,52.19", "B283,100,200,6,7,283,193,3.73,23.3,42.97", "B196,100,200,5,7,196,193,3.05,28.5,35.14", "C785,100,400,10,6,785,71,6.72,12.9,77.41", "C636,100,400,9,6,636,71,5.55,15.6,63.94", "C503,100,400,8,6,503,71,4.51,19.2,51.96", "C385,100,400,7,6,385,71,3.58,24.2,41.24", "C283,100,400,6,6,283,71,2.78,31.2,32.03", "D49,100,100,2.5,2.5,49,49,0.77,112.7,8.87"])
text_split_3 = TextSplit(Text=text, Separators=",")  # -> simplify(Result)
flip_matrix_3 = FlipMatrix(Data=text_split_3)
tree_branch_2 = TreeBranch(Tree=flip_matrix_3, Path="{3}", MaintainPaths=False)
tree_branch_3 = TreeBranch(Tree=flip_matrix_3, Path="{0}", MaintainPaths=True)
member_index = MemberIndex(Set=tree_branch_3, Member=possible_mesh_size)  # -> flatten(Index), Count
list_item_2 = ListItem(List=text, Index=member_index.Index, Wrap=True)
list_item_3 = ListItem(List=tree_branch_2, Index=member_index.Index, Wrap=True)
stream_filter_2 = StreamFilter(Gate=bar_or_mesh, Stream0=possible_bar_size, Stream1=list_item_3)
division_3 = Division(A=stream_filter_2, B=1000)

# ---- group: Permanent vertical load / Concrete Weight (kN/m3)
number_5 = Number(25)

# ---- group: Bearing Capacity / Bearing capacity factors (N)
expression_6 = Expression(fPd=expression_2, Expression="e^(π*Tan(fPd*π/180))*Tan((45+fPd/2)*π/180)^2")
expression_7 = Expression(Nq=expression_6, fPd=expression_2, Expression="2*(Nq-1)*Tan(fPd*π/180)")
expression_8 = Expression(Nq=expression_6, fPd=expression_2, Expression="(Nq-1)*(1/Tan(fPd*π/180))")

# ---- group: Bearing Capacity / Foundation base inclination factors (b)
expression_9 = Expression(a=inclination_of_the_foundation_base_to_th_2, fPd=expression_2, Expression="(1-a*π/180*Tan(fPd*π/180))^2")
expression_10 = Expression(bq=expression_9, Expression="bq")
expression_11 = Expression(bq=expression_9, Nc=expression_8, fPd=expression_2, Expression="bq-(1-bq)/(Nc*Tan(fPd*π/180))")

# ---- group: Permanent vertical load
expression_12 = Expression(Lb=addition_2, Bb=addition, tb=base_thickness_m, W=number_5, Expression="Lb*Bb*tb*W")
addition_3 = Addition(Gk=total_weight_of_kiosk_with_all_equipment_2, Gb=expression_12)
number_6 = Number(1)
multiplication_2 = Multiplication(Gtotc=addition_3, _10=number_6)

# ---- group: Bearing Capacity / Foundation base shape factors (s)
expression_13 = Expression(B=addition, L=addition_2, Expression="1-0.3*(B/L)")
expression_14 = Expression(B=addition, L=addition_2, Expression="1+0.2*(B/L)")
nq = Expression(B=addition, L=addition_2, fPd=expression_2, Expression="1+(B/L)*Sin(fPd*π/180)")
expression_15 = Expression(sq=nq, Nq=expression_6, Expression="(sq*Nq-1)/(Nq-1)")

# ---- group: Design bending moment due to wind on kiosk
multiplication_3 = Multiplication(Lk=kiosk_lenght_m, Bk=kiosk_height_m)
expression_16 = Expression(q=design_peak_velocity_pressure_2, cf=force_coefficient, A=multiplication_3, Expression="(q*cf*A)")
expression_17 = Expression(Fw=expression_16, Hk=kiosk_height_m, tb=base_thickness_m, Expression="Fw*(Hk/2+tb)")

# ---- group: Center point of the top face of the slab
point = Data(tekla_point)
A = Data(kiosk_height_m)
deconstruct = Deconstruct(Point=point)  # -> XComponent, YComponent, ZComponent
multiplication_4 = Multiplication(A=A, _1000=1000)
division_4 = Division(A=multiplication_4, B=2)
addition_4 = Addition(A=division_4, B=deconstruct.ZComponent)
construct_point = ConstructPoint(XCoordinate=deconstruct.XComponent, YCoordinate=deconstruct.YComponent, ZCoordinate=addition_4)
point_2 = Data(construct_point)

# ---- group: Kiosk base bending moment due to soft spot
expression_18 = Expression(Gtotd=multiplication_2, Lb=addition_2, Bb=addition, Expression="Gtotd/(Lb*Bb)")
expression_19 = Expression(UDL=expression_18, Expression="(UDL*2^2)/8")
expression_20 = Expression(MUDL=expression_19, Mw=expression_17, Expression="MUDL+Mw")

# ---- group: Sliding check (Passive resistance ignored)
expression_21 = Expression(Gtotc=addition_3, fk=characteristic_angle_of_shearing_resista_2, Expression="Gtotc*Tan(fk*2/3*π/180)")
division_5 = Division(Tslid=expression_16, Trest=expression_21)
expression_22 = Expression(utilisation=division_5, Expression="If(utilisation< 1,\"Sliding Check = OK\",\"Sliding Check = NOT OK\")")

# ---- group: Overturning check
expression_23 = Expression(Gtotc=addition_3, Bb=addition, Expression="Gtotc*Bb/2")
division_6 = Division(Movert=expression_17, Mrest=expression_23)
expression_24 = Expression(utilisation=division_6, Expression="If(utilisation< 1,\"Overturning check = OK\",\"Overturning check = NOT OK\")")

# ---- group: Outputs / Overturning Check
text_2 = Text(" - Utilisation ")
merge_4 = Merge(Data1=expression_24, Data2=text_2, Data3=division_6)
dummy_text_7 = Panel("Overturning Check")
join = TextJoin(Text=merge_4)
label_7 = CreateLabel(LabelText=dummy_text_7, LabelSize=12, Justification=0)
setlabel = SetLabelContents(LabelToModify=label_7, NewLabelContents=join)

stack_3 = CreateStack(UIElements=flatten(label_7), Horizontal=True)

# ---- group: Bearing Capacity / Design Bearing Capacity
expression_25 = Expression(
    cP=characteristic_cohesion_in_terms_of_effe_2,
    ycP=partial_factor_for_cohesion_ycp,
    Nc=expression_8,
    bc=expression_11,
    sc=expression_15,
    qP=expression_5,
    Nq=expression_6,
    bq=expression_9,
    sq=nq,
    ysubm=expression_3,
    B=addition,
    Ny=expression_7,
    by=expression_10,
    sy=expression_13,
    yR=partial_factor_for_bearing_resistance_yr,
    Expression="(cP/ycP*Nc*bc*sc+qP*Nq*bq*sq+0.5*ysubm*B*Ny*by*sy)/yR")
expression_26 = Expression(
    cu=characteristic_undrained_shear_strength_2,
    bc=expression_11,
    sc=expression_14,
    q=expression_4,
    FOS=fos_minimum_required_ratio_of_the_bearin,
    Expression="((π+2)*cu*bc*sc+q)/FOS")
expression_27 = Expression(
    cu=characteristic_undrained_shear_strength_2,
    ycu=partial_factor_for_undrained_shear_stren,
    bc=expression_11,
    sc=expression_14,
    q=expression_4,
    yR=partial_factor_for_bearing_resistance_yr,
    Expression="((π+2)*cu/ycu*bc*sc+q)/yR")

# ---- group: Bearing pressure check
expression_28 = Expression(Gtotd=multiplication_2, Lb=addition_2, Bb=addition, Mw=expression_17, Expression="Gtotd/(Bb*Lb)-Mw/(Bb*Lb^2/6)")
expression_29 = Expression(
    pmin=expression_28,
    Gtotd=multiplication_2,
    Lb=addition_2,
    Bb=addition,
    Mw=expression_17,
    Expression="if(pmin>0,Gtotd/(Bb*Lb)+Mw/(Bb*Lb^2/6),2*Gtotd/(3*Bb*(Lb/2-Mw/Gtotd)))")
minimum = Minimum(Pbdrained=expression_25, Pbundrained=expression_27)
division_7 = Division(BearingPressure=expression_29, BearingCapacity=minimum)
expression_30 = Expression(
    utilisation=division_7,
    Expression="If(utilisation< 1,\"Bearing Capacity Check = OK\",\"Bearing Capacity Check = NOT OK\")")

# ----
expression_31 = Expression(fck=characteristic_compressive_cylinder_stre, Expression="0.3*(fck^(2/3))")
expression_32 = Expression(fctm=expression_31, fyk=characteristic_yield_strenght_of_reinfor, Expression="0.26*fctm/fyk")
maximum = Maximum(_00013=0.0013, B=expression_32)
text_3 = Text("\"")
text_4 = Text("CoverThickness ")
number_7 = Number(nominal_cover)
text_join_3 = TextJoin(Text=[text_4, number_7])
text_5 = Text("\"")
common_mesh_attributes = Panel("""BarTypeBott 0
BarTypeTop 0
TopGradePri "A"
TopGradeSec "A"
BottGradePri "A"
BottGradeSec "A"
DefineSecBott 0
DefineSecTop 0
GridChange 1
TopAsBott 1
SpacTypBotPri 2
SpacTypBotSec 2
SpacTypTopPri 2
SpacTypTopSec 2""")
common_bar_attributes = Panel("""BarTypeBott 1
BarTypeTop 1
TopGradePri "H"
TopGradeSec "H"
BottGradePri "H"
BottGradeSec "H"
DefineSecBott 0
DefineSecTop 0
GridChange 1
TopAsBott 1
SpacTypBotPri 2
SpacTypBotSec 2
SpacTypTopPri 2
SpacTypTopSec 2""")
merge_5 = Merge(Data1=common_bar_attributes, Data2=text_join_3)
merge_6 = Merge(Data1=common_mesh_attributes, Data2=text_join_3)
text_6 = Text(" @ ")

# ---- group: TEDDS BATCH EXCEL SHEET WRITTER / Input Units
data_2 = Data(["m", "m", "m", "kN", "m", "m", "m", "deg", "kN/m^(2)", "kN/m^(2)", "kN/m^(3)", "kN/m^(3)", "deg", "m", "m", "kN/m^(2)", "", "m^(2)", "N/mm^(2)", "", "N/mm^(2)", "mm", "mm", "mm"])

# ---- group: TEDDS BATCH EXCEL SHEET WRITTER / Input Variable
# TEDDS Calcuation Output
data_3 = Data(["L_{k}", "B_{k}", "H_{k}", "G_{k}", "L_{b}", "W_{b}", "t_{b}", "\66'_{k}", "c'_{k}", "cu", "\67_{sat}", "\67_{moist}", "a", "D", "D_{w}", "q_{p}", "c_{f}", "A", "f_{ck}", "a_{cc}", "f_{yk}", "\66", "spac", "c_{nom}"])

# ---- group: TEDDS BATCH EXCEL SHEET WRITTER / Output Units
data_4 = Data("")

# ----
l__k = Data()
b__k = Data()
data_5 = Data()
data_6 = Data()
data_7 = Data()
data_8 = Data()
data_9 = Data()
data_10 = Data()
data_11 = Data()
data_12 = Data()
data_13 = Data()
data_14 = Data()
data_15 = Data()
data_16 = Data()
data_17 = Data()
data_18 = Data()
data_19 = Data()
data_20 = Data()
data_21 = Data()
# Tekla Structures Output
data_22 = Data()

# ---- group: TEDDS BATCH EXCEL SHEET WRITTER / Output Variable
data_23 = Data("U_{bear}")

# ----
utilisation = Panel([division_6, division_5, division_7])
# Output
# Design Metric Output
bounds = Bounds(Numbers=utilisation)
check = Panel([expression_24, expression_22, expression_30])

# ---- group: TEDDS BATCH EXCEL SHEET WRITTER / Units
merge_7 = Merge(Data1=data_2, Data2=data_4)  # -> graft(Result)

# ---- group: TEDDS BATCH EXCEL SHEET WRITTER / Variables
merge_8 = Merge(Data1=data_3, Data2=data_23)

# ----
deconstruct_domain = DeconstructDomain(Domain=bounds)  # -> Start, End
expression_33 = Expression(x=deconstruct_domain.End, volume=graft(expression), Expression="If(x>1,\"NA\",volume)")  # -> simplify(Result)
number_8 = Number(expression_33)
volume_of_slab_m3 = Panel(number_8)
c_script = CSharpScript(Reference=["C:\USERS\BENSAY\ONEDRIVE - COSTAIN GROUP PLC\DESKTOP\TEDDS Assembles\Tedds.TeddsCalcIA.dll", "C:\USERS\BENSAY\ONEDRIVE - COSTAIN GROUP PLC\DESKTOP\TEDDS Assembles\Tedds.TeddsIA.dll"])  # -> Output, flatten(C_Aswall), flatten(U_Aswall), flatten(C_Asbase), flatten(U_Asbase), flatten(C_boyancy), flatten(U_boyancy), flatten(C_bear), flatten(U_bear), outputrtftest; inputs RUN: Boolean, L_i: Double, W_i: Double, D_i: Double, d_w: Double, d_b: Double, D: Double, D_w: Double, a: Double, S: Double, grade: String, f_ck: Double, c_nom: Double, f_yk: Double, phi_k: Double, c_k: Double, cu: Double, gamma_moist: Double, gamma_sat: Double, phi_wall: Double, spac_wall: Double, phi_base: Double, spac_base: Double, V_iw: Double, V_c: Double, V_w: Double
# ---------- c_script: C# usings ----------
using Tekla.Structural.InteropAssemblies.TeddsCalc;
using Tekla.Structural.InteropAssemblies.Tedds;
# ---------- c_script: C# ----------
    if (RUN)
    {
      string calcFileName = "$(UserLbrDir)Ground Bearing Slab.lbr";
      string calcItemName = "FULL-GroundBearingSlab2";

      ICalculator calculator = new Calculator();
      calculator.Initialize();

      calculator.Functions.SetVar("L_{k}", L_i, "m");
      calculator.Functions.SetVar("B_{k}", W_i, "m");
      calculator.Functions.SetVar("H_{k}", D_i, "m");
      calculator.Functions.SetVar("G_{k}", d_w, "mm");
      calculator.Functions.SetVar("L_{b}", d_b, "mm");
      calculator.Functions.SetVar("D", D, "m");
      calculator.Functions.SetVar("D_{w}", D_w, "m");
      calculator.Functions.SetVar("a", a, "deg");
      calculator.Functions.SetVar("S", S, "kN/m^2");
      calculator.Functions.SetVar("grade", grade, "");
      calculator.Functions.SetVar("f_{ck}", f_ck, "N/mm^2");
      calculator.Functions.SetVar("c_{nom}", c_nom, "mm");
      calculator.Functions.SetVar("a_{cc}", a_cc, "");
      calculator.Functions.SetVar("f_{yk}", f_yk, "N/mm^2");
      calculator.Functions.SetVar("\\66'_{k}", phi_k, "deg");
      calculator.Functions.SetVar("c'_{k}", c_k, "kN/m^2");
      calculator.Functions.SetVar("cu", cu, "kN/m^2");
      calculator.Functions.SetVar("\\67_{moist}", gamma_moist, "kN/m^3");
      calculator.Functions.SetVar("\\67_{sat}", gamma_sat, "kN/m^3");
      calculator.Functions.SetVar("\\66_{wall}", phi_wall, "mm");
      calculator.Functions.SetVar("spac_{wall}", spac_wall, "mm");
      calculator.Functions.SetVar("\\66_{base}", phi_base, "mm");
      calculator.Functions.SetVar("spac_{base}", spac_base, "mm");
      calculator.Functions.SetVar("V_{iw}", V_iw, "m^3");
      calculator.Functions.SetVar("V_{c}", V_c, "m^3");
      calculator.Functions.SetVar("V_{w}", V_w, "m^3");





      "W_{b}"
      "t_{b}"
      "\66'_{k}"
      "c'_{k}"
      "cu"
      "\67_{sat}"
      "\67_{moist}"
      "a"
      "D"
      "D_{w}"
      "q_{p}"
      "c_{f}"
      "A"
      "f_{ck}"
      "a_{cc}"
      "f_{yk}"
      "\66"
      "spac"
      "c_{nom}"
      calculator.Functions.SetVar("_CalcUI", 0);

      string variables = calculator.GetVariables();
      calculator.InitializeCalc(calcFileName, calcItemName, variables);

      string C_Aswall_returned = calculator.Functions.GetVar("C_{As,wall}").ToString();
      C_Aswall = C_Aswall_returned;
      double U_Aswall_returned = calculator.Functions.GetVar("U_{As,wall}").ToDouble();
      U_Aswall = U_Aswall_returned;

      string C_Asbase_returned = calculator.Functions.GetVar("C_{As,base}").ToString();
      C_Asbase = C_Asbase_returned;
      double U_Asbase_returned = calculator.Functions.GetVar("U_{As,base}").ToDouble();
      U_Asbase = U_Asbase_returned;

      string C_boyancy_returned = calculator.Functions.GetVar("C_{boyancy}").ToString();
      C_boyancy = C_boyancy_returned;
      double U_boyancy_returned = calculator.Functions.GetVar("U_{boyancy}").ToDouble();
      U_boyancy = U_boyancy_returned;

      string C_bear_returned = calculator.Functions.GetVar("C_{bear}").ToString();
      C_bear = C_bear_returned;
      double U_bear_returned = calculator.Functions.GetVar("U_{bear}").ToDouble();
      U_bear = U_bear_returned;

      string outputrtf = calculator.GetOutput(OutputFormat.Rtf);
      outputrtftest = outputrtf;
    }
# ---------- end c_script ----------
u_bear = Panel(c_script.U_bear)
c_bear = Panel(c_script.C_bear)
c_asbase = Panel(c_script.C_Asbase)
u_asbase = Panel(c_script.U_Asbase)
panel_3 = Panel(c_script.Output)
c_aswall = Panel(c_script.C_Aswall)
u_aswall = Panel(c_script.U_Aswall)
c_boyancy = Panel(c_script.C_boyancy)
u_boyancy = Panel(c_script.U_boyancy)
file_path_2 = FilePath("C:\Users\davpot1953\OneDrive - Costain Group Plc\Regtangular tank\GH Calc Output\Output Calculation.rtf")
boolean = Boolean()
txt_writer = TextDocumentWriter(file=file_path_2, lines=c_script.outputrtftest, write=boolean, overwrite=boolean)  # inputs relative: Boolean, lines: list, write: Boolean, overwrite: Boolean, append: Boolean
# ---------- txt_writer: Python ----------
"""
Writes to a TXT or CSV file.
    Inputs:
        relative: Set to 'True' to create a new Text File using relative path. This file will live in the same directory as the Grasshopper document.
        file: TXT or CSV file to write to.
        lines: Text to write.
        write: Set to True to write.
        overwrite: Set to True to overwrite the specified file.
        append: Set to True to append the specified file.
"""

# Stephen P. Maher /  2015

ghenv.Component.Name = "Text Document Writer"
ghenv.Component.NickName = 'TXT-Writer'

import Grasshopper as gh
import os

if not relative and not file:
    msg = "Set either 'relative' to True or connect a file path to input parameter 'file'."
    ghenv.Component.AddRuntimeMessage(gh.Kernel.GH_RuntimeMessageLevel.Warning, msg)
elif relative == True:
    if overwrite == True and append == True:
        msg = "Set either 'overwrite' or 'append' to True."
        ghenv.Component.AddRuntimeMessage(gh.Kernel.GH_RuntimeMessageLevel.Error, msg)
    elif write:
        gh_path = ghdoc.Path # Get GH document's file path
        name = gh_path.split(".")[0]
        new = name.split("\\")
        file_name = new[4] + "_text_file.txt" # Create text file name
        dir = os.path.dirname(os.path.realpath(gh_path))
        file = os.path.join(dir, file_name) # Create text file path
        filePath = open(file, "w") # Open text file to create it
        if os.stat(file).st_size == 0: # Check to see if file has any data and continue if it's empty
            filePath = open(file, "w") # Open the file
            for line in lines: # Iterate through lines
                filePath.write(line + "\n") # Write separate lines
            filePath.close() # Close the file
        elif os.stat(file).st_size >= 1 and overwrite == False and append == False: # Check if file has data; if it does and 'overwrite' is  set to False, warn the user
            msg = "This file has content. If you wish to overwrite or append the file, please set either input parameters 'overwrite' or 'append' to True."
            ghenv.Component.AddRuntimeMessage(gh.Kernel.GH_RuntimeMessageLevel.Error, msg)
        elif os.stat(file).st_size >= 1 and overwrite == True: # If file has data and 'overwrite' set to True continue
            filePath = open(file, "w") # Open the file
            for line in lines: # Iterate through lines
                filePath.write(line + "\n") # Write separate lines
            filePath.close() # Close the file
        elif os.stat(file).st_size >= 1 and append == True: # If file has data and 'append' set to True and 'overwrite set to False  continue
            filePath = open(file, "a") # Open the file and 'append' document
            for line in lines: # Iterate through lines
                filePath.write("\n" + line) # Write separate lines
            filePath.close() # Close the file
    else:
        msg = "Set 'write' to True."
        ghenv.Component.AddRuntimeMessage(gh.Kernel.GH_RuntimeMessageLevel.Warning, msg)
elif relative == False or not relative:
    open(file, "w")
    if file:
        if overwrite == True and append == True:
            msg = "Set either 'overwrite' or 'append' to True."
            ghenv.Component.AddRuntimeMessage(gh.Kernel.GH_RuntimeMessageLevel.Error, msg)
        elif write:
            if os.stat(file).st_size == 0: # Check to see if file has any data and continue if it's empty
                filePath = open(file, "w") # Open the file
                for line in lines: # Iterate through lines
                    filePath.write(line + "\n") # Write separate lines
                filePath.close() # Close the file
            elif os.stat(file).st_size >= 1 and overwrite == False and append == False: # Check if file has data; if it does and 'overwrite' is  set to False, warn the user
                msg = "This file has content. If you wish to overwrite or append the file, please set either input parameters 'overwrite' or 'append' to True."
                ghenv.Component.AddRuntimeMessage(gh.Kernel.GH_RuntimeMessageLevel.Error, msg)
            elif os.stat(file).st_size >= 1 and overwrite == True: # If file has data and 'overwrite' set to True continue
                filePath = open(file, "w") # Open the file
                for line in lines: # Iterate through lines
                    filePath.write(line + "\n") # Write separate lines
                filePath.close() # Close the file
            elif os.stat(file).st_size >= 1 and append == True: # If file has data and 'append' set to True and 'overwrite set to False  continue
                filePath = open(file, "a") # Open the file and 'append' document
                for line in lines: # Iterate through lines
                    filePath.write("\n" + line) # Write separate lines
                filePath.close() # Close the file
        else:
            msg = "Set 'write' to True."
            ghenv.Component.AddRuntimeMessage(gh.Kernel.GH_RuntimeMessageLevel.Warning, msg)
    else:
        msg = "Input parameter 'file' failed to collect data."
        ghenv.Component.AddRuntimeMessage(gh.Kernel.GH_RuntimeMessageLevel.Warning, msg)
# ---------- end txt_writer ----------

# ---- group: TEDDS BATCH EXCEL SHEET OUTPUT READER
list_length_4 = ListLength(List=data_3)
list_length_5 = ListLength(List=merge_8)
button_3 = Button()
text_7 = Text("OUTPUT")
subtraction_4 = Subtraction(A=list_length_5, B=list_length_4)
read_excel_sheet_2 = ReadExcelSheet(Run=Toggle(False), Worksheet=text_7, Listen=False)  # -> UserMessages, Columns, Rows
series_2 = Series(Start=list_length_4, Step=1, Count=subtraction_4)
addition_5 = Addition(A=series_2, B=1)
construct_path_2 = ConstructPath(Indices=graft(addition_5))
tree_branch_4 = TreeBranch(Tree=read_excel_sheet_2.Columns, Path=construct_path_2, MaintainPaths=True)
cull_index = CullIndex(List=tree_branch_4, Indices=[0, 1], Wrap=True)  # -> simplify(List)
# Reinforcement using a system component from Tekla
output_variables = Panel(cull_index)

# ----
merge_9 = Merge(Data1=c_aswall, Data2=c_asbase, Data3=c_boyancy, Data4=c_bear)
merge_10 = Merge(Data1=u_aswall, Data2=u_asbase, Data3=u_boyancy, Data4=u_bear)

selobj_5 = GetSelectedObjects(AllObjects_Object=[partial_factor_for_soil_angle_of_shearin, partial_factor_for_cohesion_ycp, partial_factor_for_undrained_shear_stren, partial_factor_for_bearing_resistance_yr, bar_or_mesh])  # -> ComponentObjects, ParamObjects, OtherObjects

selobj_6 = GetSelectedObjects(AllObjects_Object=[coefficient_taking_account_of_long_term, partial_factor_of_safety_for_concrete_se])  # -> ComponentObjects, ParamObjects, OtherObjects

selobj_7 = GetSelectedObjects(AllObjects_Object=characteristic_yield_strenght_of_reinfor)  # -> ComponentObjects, ParamObjects, OtherObjects

selobj_8 = GetSelectedObjects(AllObjects_Object=possible_mesh_size)  # -> ComponentObjects, ParamObjects, OtherObjects

selobj_9 = GetSelectedObjects(AllObjects_Object=[tekla_point, possible_bar_size])  # -> ComponentObjects, ParamObjects, OtherObjects

get_list_data = GetListData(ObjectToSet=selobj_6.ParamObjects)  # -> NickName, Keys, Values, SelectedIndex
get_list_data_2 = GetListData(ObjectToSet=selobj_7.ParamObjects)  # -> NickName, Keys, Values, SelectedIndex
get_list_data_3 = GetListData(ObjectToSet=selobj_5.ParamObjects)  # -> NickName, Keys, Values, SelectedIndex
get_list_data_4 = GetListData(ObjectToSet=selobj_8.ParamObjects)  # -> NickName, Keys, Values, SelectedIndex
get_list_data_5 = GetListData(ObjectToSet=selobj_9.ParamObjects)  # -> NickName, Keys, Values, SelectedIndex
create_pulldown_menu = CreatePulldownMenu(Label=graft(get_list_data.NickName), ListItems=get_list_data.Keys, showLabel=True)
create_pulldown_menu_2 = CreatePulldownMenu(Label=get_list_data_2.NickName, ListItems=get_list_data_2.Keys, showLabel=True)
text_8 = Text(" - Utilisation ")
merge_11 = Merge(Data1=expression_22, Data2=text_8, Data3=division_5)
launchwin = LaunchWindow(
    Show=Toggle(True),
    Name="Automated Design",
    Width=division,
    Height=multiplication,
    FontFamily=item,
    ChildStatus=0,
    EnableHorizScroll=False)
merge_12 = Merge(Data1=flatten(slider_2), Data2=flatten(create_pulldown_menu_2))
merge_13 = Merge(Data1=flatten(slider))
expander_3 = CreateExpander(UIElements=flatten(merge_12), Header="Secondary Inputs", Open=False)
expander_4 = CreateExpander(UIElements=flatten(merge_13), Header="Primary Inputs", Open=True)
merge_14 = Merge(Data1=flatten(expander), Data2=flatten(expander_2))

create_pulldown_menu_3 = CreatePulldownMenu(Label=graft(get_list_data_3.NickName), ListItems=get_list_data_3.Keys, showLabel=True)
values_7 = ValueListener(Elements=create_pulldown_menu_3, SomeProperty=True)  # -> Values, Indices
setobj_5 = SetObjectValue(ObjectToSet=graft(selobj_5.ParamObjects), ValueToSet=graft(values_7.Values))

create_checklist = CreateChecklist(ChecklistItems=get_list_data_5.Keys, Selected=False)
values_8 = ValueListener(Elements=create_checklist, SomeProperty=True)  # -> Values, Indices
setobj_6 = SetObjectValue(ObjectToSet=graft(selobj_9.ParamObjects), ValueToSet=graft(values_8.Values))

create_checklist_2 = CreateChecklist(ChecklistItems=get_list_data_4.Keys, Selected=False)

# ---- group: Outputs / Sliding Check
dummy_text_8 = Panel("Sliding Check")
join_2 = TextJoin(Text=merge_11)
label_8 = CreateLabel(LabelText=dummy_text_8, LabelSize=12, Justification=0)
setlabel_2 = SetLabelContents(LabelToModify=label_8, NewLabelContents=join_2)

# ----
values_9 = ValueListener(Elements=create_pulldown_menu_2, SomeProperty=True)  # -> Values, Indices
setobj_7 = SetObjectValue(ObjectToSet=graft(selobj_7.ParamObjects), ValueToSet=values_9.Values)

values_10 = ValueListener(Elements=create_checklist_2, SomeProperty=True)  # -> Values, Indices
setobj_8 = SetObjectValue(ObjectToSet=graft(selobj_8.ParamObjects), ValueToSet=graft(values_10.Values))

values_11 = ValueListener(Elements=create_pulldown_menu, SomeProperty=True)  # -> Values, Indices
setobj_9 = SetObjectValue(ObjectToSet=graft(selobj_6.ParamObjects), ValueToSet=graft(values_11.Values))

# ---- group: Window Styling
accent_colors = ValueList({"Amber", "Blue", "Brown", "Cobalt", "Crimson", "Cyan", "Emerald", "Green", "Indigo", "Lime", "Magenta", "Mauve", "Olive", "Orange", "Pink", "Purple", "Red", "Sienna", "Steel", "Taupe", "Teal", "Violet", "Yellow"}, selected="Steel")
swatch = White(SwatchColor=RGB(38, 38, 38))
winprops = SetWindowProperties(
    Window=launchwin,
    Theme=Toggle(True),
    AccentColor=accent_colors,
    ShowTitleBar=Toggle(True),
    BackgroundColor=swatch,
    ScaleFactor=1)

# ---- group: Outputs / Sliding Check
stack_4 = CreateStack(UIElements=flatten(label_8), Horizontal=True)

# ---- group: Outputs
text_9 = Text(" mm2/m")
dummy_text_9 = Panel("Required tensile reinforcement area: ")
label_9 = CreateLabel(LabelText=dummy_text_9, LabelSize=12, Justification=0)

# ---- group: Outputs / Required tensile reinforcement area
stack_5 = CreateStack(UIElements=flatten(label_9), Horizontal=True)

# ---- group: Outputs
text_10 = Text(" mm2/m")
dummy_text_10 = Panel("Area of Adopted reinforcement: ")
label_10 = CreateLabel(LabelText=dummy_text_10, LabelSize=12, Justification=0)

# ---- group: Outputs / Required tensile reinforcement area
stack_6 = CreateStack(UIElements=flatten(label_10), Horizontal=True)

# ---- group: Outputs / Bearing Capacity
text_11 = Text(" - Utilisation ")
dummy_text_11 = Panel("Bearing Capacity")
label_11 = CreateLabel(LabelText=dummy_text_11, LabelSize=12, Justification=0)

stack_7 = CreateStack(UIElements=flatten(label_11), Horizontal=True)

# ---- group: Outputs
dummy_text_12 = Panel("Reinforcement Details:")
label_12 = CreateLabel(LabelText=dummy_text_12, LabelSize=12, Justification=0)

# ---- group: Outputs / Required tensile reinforcement area
stack_8 = CreateStack(UIElements=flatten(label_12), Horizontal=True)

# ---- group: Outputs
dummy_text_13 = Panel("Utilisation: ")
label_13 = CreateLabel(LabelText=dummy_text_13, LabelSize=12, Justification=0)

# ---- group: Outputs / Required tensile reinforcement area
stack_9 = CreateStack(UIElements=flatten(label_13), Horizontal=True)

# ---- group: Outputs
merge_15 = Merge(
    Data1=flatten(stack_7),
    Data2=flatten(stack_4),
    Data3=flatten(stack_3),
    Data4=flatten(stack_5),
    Data5=flatten(stack_6),
    Data6=flatten(stack_9),
    Data7=flatten(stack_8))
expander_5 = CreateExpander(UIElements=flatten(merge_15), Header="Results", Open=True)

# ---- group: Costain Branding / Costain Logo
logo_width = Slider(100, range=0..100)
panel_4 = Panel("C:\Users\davpot1953\OneDrive - Costain Group Plc\AutoDesign\04-Ideas_&_Misc\GUI\HumanUI")
dir = DirectoryContents(FolderPath=panel_4, Filter="*.jpg", IncludeSubfolders=False)  # -> FilePaths, FileNames
image = CreateImage(ImageSource=dir.FilePaths, ImageWidth=logo_width)
setimg = SetImage(ImageToModify=image, NewImagePath=dir.FilePaths)

# ---- group: Costain Branding
horizontal_alignment_6 = ValueList({"Left": 0, "Center": 1, "Right": 2}, selected="Center")
vertical_alignment_2 = ValueList({"Top": 2, "Middle": 1, "Bottom": 0}, selected="Top")
merge_16 = Merge(Data1=flatten(image), Data2=flatten(label))

# ---- group: Costain Branding / Costain Logo (continued)
adjustpos_8 = AdjustElementPositioning(
    ElementsToAdjust=image,
    Margin=Slider(20, range=0..100),
    AbsolutePositioning=invert(True),
    HorizontalAlignment=horizontal_alignment_6,
    VerticalAlignment=vertical_alignment_2)

# ----
merge_17 = Merge(Data1=expression_30, Data2=text_11, Data3=division_7)
merge_18 = Merge(
    Data1=flatten(slider_3),
    Data2=flatten(create_pulldown_menu_3),
    Data3=flatten(create_checklist),
    Data4=flatten(create_checklist_2),
    Data5=flatten(slider_4),
    Data6=flatten(create_pulldown_menu))
expander_6 = CreateExpander(UIElements=flatten(merge_18), Header="Preferences", Open=False)
merge_19 = Merge(Data1=flatten(label_6), Data2=flatten(tb), Data3=flatten(stack_2), Data4=flatten(stack), Data5=flatten(merge_16))
merge_20 = Merge(Data1=flatten(expander_4), Data2=flatten(expander_3), Data3=flatten(expander_6), Data4=flatten(expander_5))

# ---- group: Outputs / Bearing Capacity (continued)
join_3 = TextJoin(Text=merge_17)
setlabel_3 = SetLabelContents(LabelToModify=label_11, NewLabelContents=join_3)

# ---- group: Tabs
panel_5 = Panel("""Model
Export
Info""")
tabs = TabbedView(TabNames=panel_5, Tab0=flatten(merge_20), Tab1=flatten(merge_14), Tab2=flatten(merge_19))

# ----
addelems = AddElements(Window=launchwin, Elements=flatten(tabs), DoVLChecking=True)  # -> AddedElements, ElementNames

base = Data(point_2)
degrees = Data(rotation)
A_2 = Data(kiosk_lenght_m)
A_3 = Data(kiosk_width_m)
A_4 = Data(kiosk_height_m)
A_5 = Data(addition_2)
A_6 = Data(addition)
A_7 = Data(base_thickness_m)

# ---- group: Relaying user geometry inputs
multiplication_5 = Multiplication(A=A_2, _1000=1000)
multiplication_6 = Multiplication(A=A_3, _1000=1000)
multiplication_7 = Multiplication(A=A_4, _1000=1000)
multiplication_8 = Multiplication(A=A_5, _1000=1000)
multiplication_9 = Multiplication(A=A_6, _1000=1000)
multiplication_10 = Multiplication(A=A_7, _1000=1000)

# ---- group: Creating KIOSK Box
division_8 = Division(A=multiplication_7, B=2)
division_9 = Division(A=multiplication_5, B=2)
division_10 = Division(A=multiplication_6, B=2)
center_box = CenterBox(Base=base, X=division_9, Y=division_10, Z=division_8)

# ---- group: Determining how far the base slab extends beyond the KIOSK
subtraction_5 = Subtraction(A=multiplication_8, B=multiplication_5)
subtraction_6 = Subtraction(A=multiplication_9, B=multiplication_6)
division_11 = Division(A=subtraction_5, B=2)
division_12 = Division(A=subtraction_6, B=2)
unit_x = UnitX(Factor=division_11)  # -> simplify(graft(UnitVector))
unit_y = UnitY(Factor=division_12)  # -> simplify(graft(UnitVector))
negative = Negative(Value=unit_y)
negative_2 = Negative(Value=unit_x)
merge_21 = Merge(Data1=negative, Data2=unit_x, Data3=unit_y, Data4=negative_2)

# ---- group: Extracting the bottom face edges of KIOSK
deconstruct_brep = DeconstructBrep(Brep=center_box)  # -> Faces, Edges, Vertices
list_item_4 = ListItem(List=deconstruct_brep.Faces, Index=4, Wrap=True)
deconstruct_brep_2 = DeconstructBrep(Brep=list_item_4)  # -> Faces, Edges, Vertices

# ---- group: Move edges and rejoin curves
move = Move(Geometry=deconstruct_brep_2.Edges, Motion=merge_21)  # -> Geometry, Transform
reverse_list = ReverseList(List=merge_21)
extend_curve = ExtendCurve(Curve=move.Geometry, Type=0, Start=reverse_list, End=reverse_list)
join_curves = JoinCurves(Curves=extend_curve, Preserve=False)
boundary_surfaces = BoundarySurfaces(Edges=join_curves)

# ---- group: Rotation
radians = Radians(Degrees=degrees)
rotate_3d = Rotate3D(Geometry=center_box, Angle=radians, Center=base, Axis=Vector(0, 0, 1))  # -> Geometry, Transform
rotate_3d_2 = Rotate3D(Geometry=boundary_surfaces, Angle=radians, Center=base, Axis=Vector(0, 0, 1))  # -> simplify(Geometry), Transform

# ---- group: Extruding thickness
negative_3 = Negative(Value=multiplication_10)
unit_z = UnitZ(Factor=negative_3)
extrude = Extrude(Base=rotate_3d_2.Geometry, Direction=unit_z)

# ----
cap_holes = CapHoles(Brep=extrude)  # -> simplify(Brep)
m_to_mm = Data(multiplication_10)
m_to_mm_2 = Data(multiplication_10)
geometry = Data(rotate_3d.Geometry)
geometry_2 = Data(rotate_3d_2.Geometry)
list = Data(reverse_list)
list_2 = Data(reverse_list)
geometry_3 = Data(rotate_3d.Geometry)
geometry_4 = Data(rotate_3d_2.Geometry)

# ---- group: Box as Item
class = Slider(4, range=0..15)
brep = Brep([geometry_3, geometry])
part_attributes = PartAttributes(Class=class)
item_4 = Item(
    Geometry=brep,
    Attributes=part_attributes,
    MeshingCoarse=True,
    MeshingJagged=False,
    MeshingMinimal=False,
    MeshingSmooth=False,
    Remove_when_input_is_empty=False,
    Remove_while_inputs_are_being_modified=False,
    Run_in_background=True,
    Show_internal_lines_in_Tekla=False)
model_object = ModelObject(item_4)

# ----
panel_6 = Panel([list, list_2])

# ---- group: Slab as Slab Object / Slab thickness in mm
number_9 = Number([m_to_mm, m_to_mm_2])

# ---- group: Slab as Slab Object
text_12 = Text(foundation_name)
curve = Curve([geometry_2, geometry_4])
class_2 = Slider(1, range=0..15)
construct_uda = ConstructUDA(Name="USER_FIELD_1", Value="GBS", Type=0, Combine_UDAs=True)  # -> flatten(UDA)
part_attributes_2 = PartAttributes(Name=text_12, Class=class_2, UDA=construct_uda)
position = Position(Plane=0, Rotation=0, Depth=0, Position="Center, Bottom")
slab = Slab(
    Boundary=curve,
    Profile=number_9,
    Attributes=part_attributes_2,
    Position=position,
    Remove_when_input_is_empty=False,
    Remove_while_inputs_are_being_modified=False,
    Run_in_background=True)
model_object_2 = ModelObject(slab)

# ---- group: Required reinforcement
expression_34 = Expression(
    fck=characteristic_compressive_cylinder_stre_2,
    acc=coefficient_taking_account_of_long_term,
    yc=partial_factor_of_safety_for_concrete_se,
    Expression="fck*acc/yc")
expression_35 = Expression(tb=base_thickness_m, cnom=division_2, f=division_3, Expression="tb-cnom-f-f/2")
expression_36 = Expression(Mtot=expression_20, Lb=addition_2, Expression="Mtot/Lb")
expression_37 = Expression(
    Mtot=expression_36,
    b=base_width_m,
    d=expression_35,
    fck=characteristic_compressive_cylinder_stre_2,
    Expression="Mtot/(b*d^2*fck*1000)")
expression_38 = Expression(X=maximum, b=foundation_pad_width_for_a_rectangular_s, d=expression_35, Expression="X*(b*1000*d*1000)")
expression_39 = Expression(d=expression_35, k=expression_37, Expression="If(d/2*(1+(1-3.53*k)^0.5)<0.95*d,d/2*(1+(1-3.53*k)^0.5),0.95*d)")
partial_factor_of_saftey_for_concrete_se = ValueList({"1.15"}, selected="1.15")  # "Partial factor of saftey for concrete, see 2.4.2.4 and Table NA.1: ys"
expression_40 = Expression(fyk=characteristic_yield_strength_of_reinfor, ys=partial_factor_of_saftey_for_concrete_se, Expression="fyk/ys")
expression_41 = Expression(Mtot=expression_36, fyd=expression_40, z=expression_39, Expression="Mtot/(fyd*1000*z)*1000000")
expression_42 = Expression(tb=base_thickness_m, b=foundation_pad_width_for_a_rectangular_s, Expression="0.04*(tb*b)*1000000")

# ----
maximum_2 = Maximum(A=expression_41, B=expression_38)

# ---- group: Required reinforcement (continued)
expression_43 = Expression(asreq=maximum_2, asmax=expression_42, Expression="If(asreq≤asmax,asreq,\"NA\")")

# ----
required_tensile_reinforcement_area_as_m = Panel(expression_43)  # "Required tensile reinforcement area: As (mm2)"

range_2 = Range(Domain=Domain(50, 400), Steps=14)
panel_7 = Panel(possible_bar_size)
expression_44 = Expression(s=range_2, d=graft(panel_7), Expression="(1000/s)*((π/4)*(d²))")  # -> simplify(Result)
tree_statistics = TreeStatistics(Tree=required_tensile_reinforcement_area_as_m)  # -> Paths, Length, Count
list_length_6 = ListLength(List=range_2)
list_length_7 = ListLength(List=panel_7)
graft_tree = GraftTree(Tree=required_tensile_reinforcement_area_as_m, IncludeEmptyLists=True, IncludeNullItems=True)
flatten_tree = FlattenTree(Tree=expression_44, Path="{0}")
list_length_8 = ListLength(List=flatten_tree)
multiplication_11 = Multiplication(A=list_length_8, B=tree_statistics.Count)
repeat_data = RepeatData(Data=flatten_tree, Length=multiplication_11)
partition_list = PartitionList(List=repeat_data, Size=list_length_6)  # -> simplify(Chunks)
larger_than = LargerThan(FirstNumber=simplify(partition_list), SecondNumber=graft_tree)  # -> LargerThan, OrEqualTo
match_tree = MatchTree(Tree=partition_list, Guide=larger_than.OrEqualTo)
text_13 = Text(larger_than.OrEqualTo)
member_index_2 = MemberIndex(Set=text_13, Member="False")  # -> Index, Count
replace_items = ReplaceItems(List=match_tree, Indices=member_index_2.Index, Wrap=False)
trim_tree = TrimTree(Tree=replace_items, Depth=2)
bounds_2 = Bounds(Numbers=trim_tree)
deconstruct_domain_2 = DeconstructDomain(Domain=bounds_2)  # -> Start, End
text_14 = Text(replace_items)
text_15 = Text(deconstruct_domain_2.Start)
duplicate_data = DuplicateData(Data=text_15, Number=list_length_7, Order=True)  # -> simplify(graft(Data))
member_index_3 = MemberIndex(Set=text_14, Member=duplicate_data)  # -> Index, Count
trim_tree_2 = TrimTree(Tree=member_index_3.Index, Depth=2)
trim_tree_3 = TrimTree(Tree=member_index_3.Count, Depth=2)
list_item_5 = ListItem(List=trim_tree_2, Index=0, Wrap=True)
text_16 = Text(trim_tree_3)
member_index_4 = MemberIndex(Set=text_16, Member="1")  # -> Index, Count
list_item_6 = ListItem(List=range_2, Index=list_item_5, Wrap=True)
trim_tree_4 = TrimTree(Tree=list_item_6, Depth=1)
trim_tree_5 = TrimTree(Tree=member_index_4.Index, Depth=1)
clean_tree = CleanTree(RemoveNulls=True, RemoveInvalid=True, RemoveEmpty=False, Tree=trim_tree_4)
clean_tree_2 = CleanTree(RemoveNulls=True, RemoveInvalid=True, RemoveEmpty=False, Tree=trim_tree_5)
list_item_7 = ListItem(List=clean_tree, Index=0, Wrap=True)
list_item_8 = ListItem(List=clean_tree_2, Index=0, Wrap=True)
text_17 = Text(Tree({0}: ["BotPriSpacingList", "TopPriSpacingList", "BotSecSpacingList", "TopSecSpacingList"], {1}: ["TopDiaPri", "BottDiaPri", "TopDiaSec", "BottDiaSec"]))
list_item_9 = ListItem(List=panel_7, Index=list_item_8, Wrap=True)
list_length_9 = ListLength(List=text_17)
duplicate_data_2 = DuplicateData(Data=graft([list_item_7, list_item_9]), Number=list_length_9, Order=True)
trim_tree_6 = TrimTree(Tree=duplicate_data_2, Depth=2)
flatten_tree_2 = FlattenTree(Tree=text_17, Path="{0}")
list_length_10 = ListLength(List=trim_tree_6)
graft_tree_2 = GraftTree(Tree=trim_tree_6, IncludeEmptyLists=True, IncludeNullItems=True)
repeat_data_2 = RepeatData(Data=flatten_tree_2, Length=list_length_10)  # -> flatten(Data)
graft_tree_3 = GraftTree(Tree=repeat_data_2, IncludeEmptyLists=True, IncludeNullItems=True)
match_tree_2 = MatchTree(Tree=graft_tree_3, Guide=graft_tree_2)

spacing_of_bar_reinforcement_to_consider = Panel(range_2)
repeat_data_3 = RepeatData(Data=text_5, Length=list_length_10)  # -> flatten(Data)
graft_tree_4 = GraftTree(Tree=repeat_data_3, IncludeEmptyLists=True, IncludeNullItems=True)
match_tree_3 = MatchTree(Tree=graft_tree_4, Guide=graft_tree_2)
text_18 = Text(match_tree_3)
text_19 = Text(match_tree_3)
text_join_4 = TextJoin(Text=[text_19, graft_tree_2, text_18])

text_join_5 = TextJoin(Text=[match_tree_2, text_join_4], Join=" ")
trim_tree_7 = TrimTree(Tree=text_join_5, Depth=1)

insert_items = InsertItems(List=trim_tree_7, Item=merge_5, Indices=merge_5, Wrap=True)

text_split_4 = TextSplit(Text=list_item_2, Separators=",")  # -> simplify(Result)
flip_matrix_4 = FlipMatrix(Data=text_split_4)
tree_statistics_2 = TreeStatistics(Tree=required_tensile_reinforcement_area_as_m)  # -> Paths, Length, Count
tree_branch_5 = TreeBranch(Tree=flip_matrix_4, Path="{5}", MaintainPaths=True)
list_length_11 = ListLength(List=tree_branch_5)
duplicate_data_3 = DuplicateData(Data=tree_branch_5, Number=tree_statistics_2.Count, Order=True)
partition_list_2 = PartitionList(List=duplicate_data_3, Size=list_length_11)  # -> simplify(Chunks)
larger_than_2 = LargerThan(FirstNumber=partition_list_2, SecondNumber=required_tensile_reinforcement_area_as_m)  # -> LargerThan, OrEqualTo
text_20 = Text(larger_than_2.OrEqualTo)
member_index_5 = MemberIndex(Set=text_20, Member="False")  # -> Index, Count
replace_items_2 = ReplaceItems(List=tree_branch_5, Indices=member_index_5.Index, Wrap=False)  # -> simplify(List)
bounds_3 = Bounds(Numbers=replace_items_2)
deconstruct_domain_3 = DeconstructDomain(Domain=bounds_3)  # -> Start, End
text_21 = Text(deconstruct_domain_3.Start)
member_index_6 = MemberIndex(Set=replace_items_2, Member=text_21)  # -> simplify(Index), Count
list_item_10 = ListItem(List=member_index_6.Index, Index=0, Wrap=True)
tree_branch_6 = TreeBranch(Tree=text_split_4, Path=list_item_10, MaintainPaths=False)
list_item_11 = ListItem(List=tree_branch_6, Index=[0, 1, 2, 3, 4], Wrap=True)  # -> graft(Item)
text_22 = Text(Tree({1}: ["MeshNameBott", "MeshNameTop"], {2}: ["BotPriSpacingList", "TopPriSpacingList"], {3}: ["BotSecSpacingList", "TopSecSpacingList"], {4}: ["TopDiaPri", "BottDiaPri"], {5}: ["TopDiaSec", "BottDiaSec"]))
list_length_12 = ListLength(List=text_22)
text_23 = Text(flatten(text_22))
trim_tree_8 = TrimTree(Tree=list_item_11, Depth=1)
duplicate_data_4 = DuplicateData(Data=list_item_11, Number=list_length_12, Order=True)
list_item_12 = ListItem(List=trim_tree_8, Index=[1, 3], Wrap=True)
trim_tree_9 = TrimTree(Tree=duplicate_data_4, Depth=2)
graft_tree_5 = GraftTree(Tree=trim_tree_9, IncludeEmptyLists=True, IncludeNullItems=True)
list_length_13 = ListLength(List=trim_tree_9)
repeat_data_4 = RepeatData(Data=text_23, Length=list_length_13)  # -> flatten(Data)
graft_tree_6 = GraftTree(Tree=repeat_data_4, IncludeEmptyLists=True, IncludeNullItems=True)
match_tree_4 = MatchTree(Tree=graft_tree_6, Guide=graft_tree_5)

panel_8 = Panel(flip_matrix_4)
list_item_13 = ListItem(List=trim_tree_8, Index=0, Wrap=True)
repeat_data_5 = RepeatData(Data=text_3, Length=list_length_13)  # -> flatten(Data)
graft_tree_7 = GraftTree(Tree=repeat_data_5, IncludeEmptyLists=True, IncludeNullItems=True)

# ---- group: Reinforcement Utilisation
list_item_14 = ListItem(List=required_tensile_reinforcement_area_as_m, Index=list_item_8, Wrap=True)
list_item_15 = ListItem(List=tree_branch_6, Index=5, Wrap=True)
list_item_16 = ListItem(List=required_tensile_reinforcement_area_as_m, Index=list_item_10, Wrap=True)
stream_filter_3 = StreamFilter(Gate=bar_or_mesh, Stream0=list_item_14, Stream1=list_item_16)
stream_filter_4 = StreamFilter(Gate=bar_or_mesh, Stream0=text_15, Stream1=list_item_15)
required_tensile_reinforcement_area_as_m_2 = Panel(stream_filter_3)  # "Required tensile reinforcement area: As (mm2)"
area_of_adopted_reinforcement = Panel(stream_filter_4)
division_13 = Division(A=required_tensile_reinforcement_area_as_m_2, B=area_of_adopted_reinforcement)
utilisation_2 = Panel(division_13)

# ---- group: Outputs (continued)
merge_22 = Merge(Data1=dummy_text_9, Data2=required_tensile_reinforcement_area_as_m_2, Data3=text_9)
join_4 = TextJoin(Text=merge_22)
setlabel_4 = SetLabelContents(LabelToModify=label_9, NewLabelContents=join_4)

merge_23 = Merge(Data1=dummy_text_10, Data2=area_of_adopted_reinforcement, Data3=text_10)
join_5 = TextJoin(Text=merge_23)
setlabel_5 = SetLabelContents(LabelToModify=label_10, NewLabelContents=join_5)

merge_24 = Merge(Data1=dummy_text_13, Data2=utilisation_2)
join_6 = TextJoin(Text=merge_24)
setlabel_6 = SetLabelContents(LabelToModify=label_13, NewLabelContents=join_6)

# ----
match_tree_5 = MatchTree(Tree=graft_tree_7, Guide=graft_tree_5)
text_24 = Text(match_tree_5)
text_25 = Text(match_tree_5)
text_join_6 = TextJoin(Text=[text_25, graft_tree_5, text_24])

text_join_7 = TextJoin(Text=[match_tree_4, text_join_6], Join=" ")
trim_tree_10 = TrimTree(Tree=text_join_7, Depth=1)

# ---- group: Reinforcement Properties for TEDDS
merge_25 = Merge(Data1=list_item_7, Data2=list_item_9)
stream_filter_5 = StreamFilter(Gate=bar_or_mesh, Stream0=merge_25, Stream1=list_item_12)
list_item_17 = ListItem(List=stream_filter_5, Index=0, Wrap=True)
list_item_18 = ListItem(List=stream_filter_5, Index=1, Wrap=False)
diameter = Panel(list_item_18)
spacing = Panel(list_item_17)

# ----
insert_items_2 = InsertItems(List=trim_tree_10, Item=merge_6, Indices=merge_6, Wrap=True)
merge_26 = Merge(Data1=diameter, Data2=text_6, Data3=spacing)
text_join_8 = TextJoin(Text=merge_26)
stream_filter_6 = StreamFilter(Gate=bar_or_mesh, Stream0=text_join_8, Stream1=list_item_13)

# ---- group: Outputs (continued)
merge_27 = Merge(Data1=dummy_text_12, Data2=stream_filter_6)
join_7 = TextJoin(Text=merge_27)
setlabel_7 = SetLabelContents(LabelToModify=label_12, NewLabelContents=join_7)

# ----
stream_filter_7 = StreamFilter(Gate=bar_or_mesh, Stream0=insert_items, Stream1=insert_items_2)

text_26 = Data(stream_filter_7)
input = Data(model_object_2)
text_join_9 = TextJoin(Text=text_26, Join=";")
plugin_input = PluginInput(Input=input)  # -> simplify(graft(PluginInput))
trim_tree_11 = TrimTree(Tree=text_join_9, Depth=1)
component_catalog = ComponentCatalog(CName="MeshBars", CNumber=-100000, CType="COMPONENT", UIName="Mesh Bars")
panel_9 = Panel(text_26)
component = Component(
    Name=component_catalog,
    Attributes=trim_tree_11,
    PluginInput=plugin_input,
    Remove_when_input_is_empty=False,
    Remove_while_inputs_are_being_modified=True,
    Run_in_background=True)

text_27 = Data(stream_filter_7)
text_split_5 = TextSplit(Text=text_27, Separators=" ")
panel_10 = Panel("""TopPriSpacingList
TopDiaPri""")
trim_tree_12 = TrimTree(Tree=text_split_5, Depth=1)
member_index_7 = MemberIndex(Set=trim_tree_12, Member=panel_10)  # -> Index, Count
trim_tree_13 = TrimTree(Tree=member_index_7.Index, Depth=1)
addition_6 = Addition(A=trim_tree_13, B=1)
list_item_19 = ListItem(List=trim_tree_12, Index=addition_6, Wrap=True)
trim_tree_14 = TrimTree(Tree=list_item_19, Depth=1)
tree = Data(trim_tree_14)

required_tensile_reinforcement_area_as_m_3 = Panel(required_tensile_reinforcement_area_as_m_2)  # "Required tensile reinforcement area: As (mm2)"

# ---- group: TEDDS BATCH EXCEL SHEET WRITTER / Values
entwine = Entwine(
    Branch00=kiosk_lenght_m,
    Branch01=kiosk_width_m,
    Branch02=kiosk_height_m,
    Branch03=total_weight_of_kiosk_with_all_equipment_2,
    Branch04=addition_2,
    Branch05=addition,
    Branch06=base_thickness_m,
    Branch07=characteristic_angle_of_shearing_resista_2,
    Branch08=characteristic_cohesion_in_terms_of_effe_2,
    Branch09=characteristic_undrained_shear_strength_2,
    Branch010=saturated_soil_density_conservatively_ba_2,
    Branch011=moist_bulk_soil_density,
    Branch012=inclination_of_the_foundation_base_to_th_2,
    Branch013=embedment_depth,
    Branch014=water_table_depth_below_ground_level,
    Branch015=design_peak_velocity_pressure_2,
    Branch016=force_coefficient,
    Branch017=multiplication_3,
    Branch018=characteristic_compressive_cylinder_stre_2,
    Branch019=coefficient_taking_account_of_long_term,
    Branch020=characteristic_yield_strength_of_reinfor,
    Branch021=diameter,
    Branch022=spacing,
    Branch023=number_7,
    FlattenInputs=True)

# ----
area_of_adopted_reinforcement_2 = Panel(area_of_adopted_reinforcement)

# ---- group: TEDDS BATCH EXCEL SHEET WRITTER
list_length_14 = ListLength(List=data_4)
list_length_15 = ListLength(List=entwine)  # -> flatten(Length)
repeat_data_6 = RepeatData(Data=0, Length=list_length_14)
list_item_20 = ListItem(List=list_length_15, Index=0, Wrap=True)
duplicate_data_5 = DuplicateData(Data=repeat_data_6, Number=list_item_20, Order=True)
partition_list_3 = PartitionList(List=duplicate_data_5, Size=list_item_20)  # -> simplify(Chunks)
entwine_2 = Entwine(Branch00=entwine, Branch01=partition_list_3, FlattenInputs=True)  # -> flatten(Result)
partition_list_4 = PartitionList(List=entwine_2, Size=list_item_20)
merge_28 = Merge(Data1=merge_7, Data2=partition_list_4)  # -> simplify(Result)
file_path_3 = FilePath("C:\Users\bensay\Costain Group Plc\Digital Engineering Solutions - AutoDesign\02-Workstreams\18-Ground Bearing Slab\AutoCalcs - TEDDS\Batch Design OLD.xlsm")
excel_write = ExcelWrite(
    WriteExcelData=Button(),
    WorkbookPath=file_path_3,
    WorksheetName="DATA",
    ColumnHeadings=merge_8,
    Data=merge_28,
    ClearSheet=True)

# ----
utilisation_3 = Panel(utilisation_2)
panel_11 = Panel(merge_28)
panel_12 = Panel(excel_write)

input_2 = Data(model_object_2)
text_28 = Text(tree)
panel_13 = Panel("""SB_stirrup_spac1
SBSize_list""")
tree_statistics_3 = TreeStatistics(Tree=text_28)  # -> Paths, Length, Count
graft_tree_8 = GraftTree(Tree=text_28, IncludeEmptyLists=True, IncludeNullItems=True)
duplicate_data_6 = DuplicateData(Data=panel_13, Number=tree_statistics_3.Count, Order=True)
trim_tree_15 = TrimTree(Tree=duplicate_data_6, Depth=1)
graft_tree_9 = GraftTree(Tree=trim_tree_15, IncludeEmptyLists=True, IncludeNullItems=True)
match_tree_6 = MatchTree(Tree=graft_tree_9, Guide=graft_tree_8)
text_join_10 = TextJoin(Text=[match_tree_6, graft_tree_8], Join=" ")
attributes = Panel("""SBGrade "H"
SBGrade_list "H"
SB_x_end 200
SB_x_start 200
SBRadius_list 20""")
trim_tree_16 = TrimTree(Tree=text_join_10, Depth=1)
plugin_input_2 = PluginInput(Input=input_2)  # -> simplify(graft(PluginInput))
component_catalog_2 = ComponentCatalog(CNumber=150000092, CType="COMPONENT", UIName="Border rebar (92)")

merge_29 = Merge(Data1=attributes, Data2=text_join_3)

insert_items_3 = InsertItems(List=trim_tree_16, Item=merge_29, Indices=merge_29, Wrap=True)
text_join_11 = TextJoin(Text=insert_items_3, Join=";")

trim_tree_17 = TrimTree(Tree=text_join_11, Depth=1)

component_2 = Component(
    Name=component_catalog_2,
    Attributes=trim_tree_17,
    PluginInput=plugin_input_2,
    Remove_when_input_is_empty=False,
    Remove_while_inputs_are_being_modified=True,
    Run_in_background=True)
panel_14 = Panel(trim_tree_17)
